vi "Main.gviweb"   [LabVIEW NXG 4.0.0]
panel controls:
  "Run Sequence": bool
  "Simulate Failure": enum{"None", "Keyboard", "Video", "Power"} = "None"
  "Amplitude": f64 = 10
  "Automatically pick a system": bool
  "System": i32
  "Test": i32
  "Email": string
  "Manufacturing Failure": enum{"None", "Noise", "LED", "Power"} = "None"
panel indicators:
  "Data Grid": T1[]
  "Parameters": i32
  "JobView": cluster{"TimeStamp": string, "State": string}[]
types:
  T1 = cluster{"System": string, "Connection": string, "Test Program": string, "UUT": string, "Status": string, "Last Updated": string, "Queue": f64}
uses:
  NI::Skyline::Configuration::Open Configuration.gvi
  WebApp::Filter Systems by Package.gviweb
  WebApp::Filter Jobs By Name.gviweb
  WebApp::Get Tester Status.gviweb
  WebApp::Pick System.gviweb
  WebApp::Get Minion ID.gviweb
diagram:
  w1 = FALSE  # Development
  case (w1) {
    frame False, Default {
      # Set Development boolean to False in order to
      # clear server, username, and password
      # before building and deploying the application
      # to your web server or SystemLink.
      w5 = ""  # Server
      w6 = ""  # Username
      w7 = ""  # Password
      w2 = w7
      w3 = w6
      w4 = w5
    }
    frame True {
      # Set Development boolean to True and
      # change the server, username, and password
      # to match your web server.  Also, ensure that CORS
      # is enabled on your web server before trying to
      # interactively run your application from within NXG.
      w8 = "http://10.96.1.30:9001"  # Server
      w9 = "admin"  # Username
      w10 = "admin"  # Password
      w2 = w10
      w3 = w9
      w4 = w8
    }
  }
  call "Open Configuration.gvi"(server url=w4, username=w3, password=w2) -> (configuration=w11, error out=w12)
  while {
    call "Filter Systems by Package.gviweb"(configuration in=w11, package="ni-teststandexecutor") -> (systems=w13)
    for {
      w14 = each element of w13
      Property Node(instance in=w14) -> ("alias"=w16)
      append w16 to w15
    }
    Property Node(instance in=reference to "System", "Items"=w15)
    Wait Until Next Multiple(multiple to wait=1000)
    stop if FALSE
  }
  while {
    call "Filter Jobs By Name.gviweb"(configuration in=w11, name="niteststand_remote_executor.execute") -> (JobView=w17)
    $JobView <- w17
    Wait Until Next Multiple(multiple to wait=1000)
    stop if FALSE
  }
  while {
    call "Get Tester Status.gviweb"(Configuration=w11, error in=no error) -> (Testers=w18)
    $"Data Grid" <- w18
    Wait Until Next Multiple(multiple to wait=1000)
    stop if FALSE
  }
  call "Test Plans.gviweb"(Input=reference to "Test", error in=w12) -> (Test Plans=w19, Error Out=w20)
  s1 = 1  # shift register
  while {
    event (timeout = s1) {
      on "Run Sequence" Value changed {
        Property Node(instance in=reference to "Test") -> ("Value"=w21)
        Array Index(array=w19) -> (out0[w21]=w22)
        Property Node(instance in=w22) -> ("Test"=w23)
        # Sequence must be some where in the TestStand path like C:\Users\Public\Documents\TestSequences
        case ($"Automatically pick a system") {
          frame True {
            call "Pick System.gviweb"(configuration in=w11, sequence=w23, error in=w20) -> (configuration out=w25, minion id=w24, error out=w26)
          }
          frame False {
            Property Node(instance in=reference to "System") -> ("Items"=w27)
            Array Index(array=w27) -> (out0[$System]=w28)
            call "Get Minion ID.gviweb"(configuration in=w11, hostname=w28, error in=w20) -> (configuration out=w25, id=w24, error out=w26)
          }
        }
        case (w23) {
          frame Default {
            w29 = "[]"
          }
          frame "Computer Motherboard Tests.seq" {
            case ($"Simulate Failure") {
              frame "None", Default {
                w29 = ""
              }
              frame "Keyboard" {
                w29 = "Keyboard=5"
              }
              frame "Video" {
                w29 = "Video=12"
              }
              frame "Power" {
                w29 = "PowerFail=True"
              }
            }
          }
          frame "Manufacturing Test.seq" {
            case ($"Manufacturing Failure") {
              frame "None", Default {
                w29 = ""
              }
              frame "Noise" {
                w29 = "FailNoiseToleranceTest=True"
              }
              frame "LED" {
                w29 = "FailLEDTest=True"
              }
              frame "Power" {
                w29 = "Fail24VPowerCheck=True"
              }
            }
          }
          frame "Power Test.seq" {
            Number To Fractional String(number=$Amplitude, precision (6)=2) -> (F-format string=w30)
            Concatenate Strings("Amplitude=", w30) -> w29
          }
        }
        Concatenate Strings("EmailAddress=", $Email) -> w31
        Build Array(w29, w31) -> w32
        Flatten To JSON(anything=w32) -> (JSON string=w33)
        call "Run Sequence.gviweb"(configuration=w25, minion ID=w24, sequence=w23, args=w33, error in=w26, timeout=600) -> (error out=w34)
      }
      on "Test" Value changed; "Timeout" {
        Array Index(array=w19) -> (out0[$Test]=w35)
        Property Node(instance in=w35) -> ("Package"=w36)
        call "Filter Systems by Package.gviweb"(configuration in=w11, package=w36) -> (systems=w37)
        for {
          w38 = each element of w37
          Property Node(instance in=w38) -> ("alias"=w40)
          append w40 to w39
        }
        Sort 1D Array(array=w39) -> (sorted array=w41)
        Property Node(instance in=reference to "System", "Items"=w41)
        $Parameters <- $Test
      }
      on "Automatically pick a system" Value changed {
        Event Data() -> ("New Value"=w42)
        Property Node(instance in=reference to "System", "Disabled"=w42)
      }
    }
    next s1 = -1
    stop if FALSE
  }
